# Grasshopper definition example.gh (Grasshopper 1.0.7)
# plug-ins: THERB, baues-toolbox Info

number_slider = Slider(0.1, range=0..0.1)
brep = Brep([<brep referenced from the Rhino model> x3])
srf = Surface([<surface referenced from the Rhino model> x2])
srf_2 = Surface(<surface referenced from the Rhino model>)
therb = THERB(Geometries=brep, Windows=srf, Tolerance=number_slider)  # -> Rooms, Faces, Windows, Baues
list = ValueList({"明色": 0, "黒": 1, "コンクリート": 3, "中等色": 4, "白タイル": 5, "光沢　アルミ": 6, "白ペイント": 7}, selected="明色")
create = Create(Geometries=brep, Windows=srf, Tolerance=number_slider)  # -> Baues, BauesJson
shading = Shading(Shading=srf_2)  # -> Baues, BauesJson
uploadbaues = UploadBaues(Baues=[create.Baues, shading.Baues])  # -> ProjectID, Version, URL
panel = Panel(therb.Baues)
